# Grasshopper definition Sound2.gh (Grasshopper 1.0.7)

mesh = Mesh(<mesh referenced from the Rhino model>)
pt = Point(<point referenced from the Rhino model>)
# WITH 10 BOUNCES and 500 LBL IT SHOULD TAKE NO MORE THAN 10 MINS TO CALCULATE... REDUCE FOR FASTER RESULTS
number_slider = Slider(10, range=0..10)
number_slider_2 = Slider(500, range=0..1000)
# NON PANELIZED FAB LAB ELEMENTS AND NEW GEOMETRY TO BOUNCE OFF OF
number_slider_3 = Slider(700, range=0..1000)

# ---- group: NEW GEOMERTY
geo = Geometry([<brep referenced from the Rhino model> x3])

# ----
pt_2 = ConstructPoint(XCoordinate=0, YCoordinate=0, ZCoordinate=0)

# ---- group: CNC MACHINE
geo_2 = Geometry([<brep referenced from the Rhino model> x6])

# ---- group: EXISITING FABLAB
geo_3 = Geometry([<mesh referenced from the Rhino model> x17])

# ----
demesh = DeconstructMesh(Mesh=mesh)  # -> Vertices, Faces, Colours, Normals

# ---- group: 6 POINTS ON CNC TO START
pt_3 = Point(pt)

# ----
mesh_2 = Mesh(geo)
mesh_3 = Mesh(geo_3)
# CONNECT IF YOU WANT TO SEE THE DIFFERENCE BETWEEN EXISTING FABLAB AND FABLAB w/ NEW GEO
mesh_4 = Mesh(geo_2)
vec2pt = Vector2Pt(PointA=pt, PointB=demesh.Vertices, Unitize=False)  # -> Vector, Length
geo_4 = Merge03(StreamA=geo_3, StreamB=mesh_4, StreamC=mesh_2)
data = Data(pt_3)
unit = UnitVector(Vector=vec2pt.Vector)

# ---- group: RAYTRACING ENGINE
forwardraytracing = Ladybug_ForwardRaytracing(startPts=graft(data), startVectors=unit, context=flatten(geo_4), numOfBounce="18", lastBounceLen=number_slider_3)  # -> simplify(rays); plug-in component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

# ----
data_2 = Data(forwardraytracing)
reb = RebuildCurve(Curve=data_2, Degree=Slider(3, range=0..10), Count=Slider(600, range=0..1000), Tangents=False)  # -> reparameterize(Curve)
deface = DeconstructFace(Face=demesh.Faces)  # -> simplify(graft(CornerA)), simplify(graft(CornerB)), simplify(graft(CornerC)), CornerD
merge = Merge(Data1=deface.CornerA, Data2=deface.CornerB, Data3=deface.CornerC)
item = ListItem(List=reb, Index=merge, Wrap=True)  # -> simplify(Item)
data_3 = Data(item)
len = Length(Curve=data_3)
division = Division(A=Slider(37, range=0..300), B=len)
eval = EvaluateCurve(Curve=reparameterize(data_3), Parameter=division)  # -> Point, Tangent, Angle
graft = GraftTree(Tree=eval.Point, IncludeEmptyLists=True, IncludeNullItems=True)
item_2 = ListItem(List=eval.Point, Index=0, Wrap=True)  # -> Item, Item1, Item2
data_4 = Data(eval.Point)
item_3 = ListItem(List=data_2, Index=merge, Wrap=True)  # -> simplify(Item)
srf4pt = _4PointSurface(CornerA=item_2.Item, CornerB=item_2.Item1, CornerC=item_2.Item2)
smesh = SimpleMesh(Brep=srf4pt)
mesh_5 = Mesh(flatten(smesh))
number_slider_4 = Slider(50000, range=0..100000)
yz = YZPlane(Origin=pt)
xz = XZPlane(Origin=pt)
xy = XYPlane(Origin=pt)
mjoin = MeshJoin(Meshes=mesh_5)
contour = Contour(Shape=mjoin, Point=yz, Direction=yz, Distance=number_slider_4)
contour_2 = Contour(Shape=mjoin, Point=xz, Direction=xz, Distance=number_slider_4)
contour_3 = Contour(Shape=mjoin, Point=xy, Direction=xy, Distance=number_slider_4)
